# Grasshopper definition AEC Tech Barcelona Hackaton - Bridge Toolpath.gh (Grasshopper 1.0.7)
# plug-ins: Pufferfish, ShapeDiverForGrasshopper, GrasshopperHyperGooComponents

span = Slider(25000, range=5000..100000)
cluster = Cluster(span=span)  # -> tc1_2, bc1_2, tc2_2, bc2_2, tc3_2, bc3_2, bridge_2, joint1_2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
merge = Merge(Data1=cluster.tc1_2, Data2=cluster.tc2_2, Data3=cluster.tc3_2)
merge_2 = Merge(Data1=cluster.bc1_2, Data2=cluster.bc2_2, Data3=cluster.bc3_2)
end_points = EndPoints(Curve=merge)  # -> Start, End
end_points_2 = EndPoints(Curve=merge_2)  # -> Start, End
line = Line(StartPoint=end_points.Start, EndPoint=end_points_2.Start)
line_2 = Line(StartPoint=end_points.End, EndPoint=end_points_2.End)
shatter = Shatter(Curve=line, Parameters=0)
shatter_2 = Shatter(Curve=line_2, Parameters=0)
list_item = ListItem(List=shatter, Index=0, Wrap=True)
list_item_2 = ListItem(List=shatter_2, Index=0, Wrap=True)
explode = Explode(Curve=list_item, Recursive=True)  # -> Segments, reverse(Vertices)
explode_2 = Explode(Curve=list_item_2, Recursive=True)  # -> Segments, Vertices
merge_3 = Merge(Data1=explode.Vertices, Data2=explode_2.Vertices)
polyline = PolyLine(Vertices=merge_3, Closed=False)
number_slider = Slider(100, range=0..100)
divide_curve = DivideCurve(Curve=polyline, Count=144, Kinks=False)  # -> Points, Tangents, Parameters
divide_curve_2 = DivideCurve(Curve=merge_2, Count=144, Kinks=False)  # -> Points, Tangents, Parameters
cull_index = CullIndex(List=divide_curve.Points, Indices=[0, -1], Wrap=True)
cull_index_2 = CullIndex(List=divide_curve_2.Points, Indices=[0, -1], Wrap=True)
negative = Negative(Value=number_slider)
negative_2 = Negative(Value=number_slider)
line_3 = Line(StartPoint=cull_index, EndPoint=cull_index_2)
division = Division(A=negative, B=2)
division_2 = Division(A=negative_2, B=2)
extend_curve = ExtendCurve(Curve=line_3, Type=0, Start=negative, End=negative_2)
extend_curve_2 = ExtendCurve(Curve=line_3, Type=0, Start=division, End=division_2)
explode_3 = Explode(Curve=extend_curve, Recursive=True)  # -> Segments, simplify(Vertices)
repeat_data = RepeatData(Data=False, Length=10)
path_mapper = PathMapper(explode_3.Vertices, source="{A;B}(i)", target="{A;i}(B)")
merge_4 = Merge(Data1=repeat_data, Data2=True)  # -> flatten(Result)
dispatch = Dispatch(List=path_mapper, DispatchPattern=merge_4)  # -> ListA, ListB
partition_list = PartitionList(List=dispatch.ListB, Size=10)
dispatch_2 = Dispatch(List=partition_list, DispatchPattern=[True, False])  # -> ListA, ListB
polyline_2 = PolyLine(Vertices=dispatch_2.ListA, Closed=False)
path_mapper_2 = PathMapper(polyline_2, source="{A;B;C}(I)", target="{A;I;C}(b)")
data = Data(path_mapper_2)
list_item_3 = ListItem(List=data, Index=0, Wrap=True)  # -> Item, Item1
dispatch_3 = Dispatch(List=list_item_3.Item1, DispatchPattern=[True, False])  # -> ListA, ListB
merge_5 = Merge(Data1=list_item_3.Item, Data2=dispatch_3.ListA)
list_item_4 = ListItem(List=merge_5, Index=0, Wrap=True)  # -> Item, Item1
trim_tree = TrimTree(Tree=list_item_4.Item1, Depth=1)
list_length = ListLength(List=trim_tree)  # -> expr("X-1", Length)
trim_tree_2 = TrimTree(Tree=list_item_4.Item, Depth=1)
repeat_data_2 = RepeatData(Data=[True, False], Length=list_length)
replace_items = ReplaceItems(List=repeat_data_2, Item=False, Indices=0, Wrap=False)
dispatch_4 = Dispatch(List=trim_tree_2, DispatchPattern=[True, False])  # -> ListA, ListB
dispatch_5 = Dispatch(List=trim_tree, DispatchPattern=replace_items)  # -> ListA, ListB
weave = Weave(Pattern=[0, 1], Stream0=dispatch_4.ListB, Stream1=dispatch_5.ListA, NullGaps=False)
explode_4 = Explode(Curve=weave, Recursive=True)  # -> Segments, Vertices
trim_tree_3 = TrimTree(Tree=explode_4.Vertices, Depth=1)
series = Series(Start=2, Step=1, Count=5)
data_2 = Data(merge_2)
divide_curve_3 = DivideCurve(Curve=data_2, Count=55, Kinks=False)  # -> reverse(Points), Tangents, Parameters
cull_index_3 = CullIndex(List=trim_tree_3, Indices=series, Wrap=True)
data_3 = Data(merge)
cull_index_4 = CullIndex(List=reverse(cull_index_3), Indices=series, Wrap=True)  # -> reverse(List)
divide_curve_4 = DivideCurve(Curve=data_3, Count=30, Kinks=False)  # -> Points, Tangents, Parameters
end_points_3 = EndPoints(Curve=extend_curve_2)  # -> Start, End
match_tree = MatchTree(Tree=cull_index_4, Guide=divide_curve_3.Points)
data_4 = Data(line)
data_5 = Data(end_points_3.End)
end_points_4 = EndPoints(Curve=data_4)  # -> Start, End
match_tree_2 = MatchTree(Tree=graft(end_points_4.End), Guide=divide_curve_3.Points)
dispatch_6 = Dispatch(List=data_5, DispatchPattern=[False, True])  # -> reverse(ListA), ListB
match_tree_3 = MatchTree(Tree=dispatch_6.ListA, Guide=divide_curve_3.Points)
merge_6 = Merge(Data1=match_tree_2, Data2=divide_curve_4.Points, Data3=divide_curve_3.Points, Data4=match_tree, Data5=match_tree_3)
flip_matrix = FlipMatrix(Data=merge_6)
nurbs_curve = NurbsCurve(Vertices=flip_matrix, Degree=3, Periodic=False)  # -> Curve, Length, Domain
divide_curve_5 = DivideCurve(Curve=nurbs_curve.Curve, Count="500", Kinks=False)  # -> Points, Tangents, Parameters
segmentation_for_printing = Slider(2550, range=1000..2550)
flip_matrix_2 = FlipMatrix(Data=divide_curve_5.Points)
division_3 = Division(A=span, B="500")
polyline_3 = PolyLine(Vertices=flip_matrix_2, Closed=False)  # -> flatten(Polyline)
division_4 = Division(A=segmentation_for_printing, B=division_3)
partition_list_2 = PartitionList(List=polyline_3, Size=division_4)
list_item_5 = ListItem(List=partition_list_2, Index=0, Wrap=True)
yz_plane = YZPlane(Origin=Point(0, 0, 0))
explode_5 = Explode(Curve=partition_list_2, Recursive=True)  # -> Segments, Vertices
divisions_color = ColourSwatch(SwatchColor=RGB(0, 0, 0))
trim_tree_4 = TrimTree(Tree=explode_5.Vertices, Depth=1)
bounding_rectangle = BoundingRectangle(Geometry=list_item_5, Plane=yz_plane, Axis=0, Slide=0, Union=True)  # -> Bounding, DimensionX, DimensionY
gltf2material = GlTF20Material(
    BaseColorFactor=divisions_color,
    MetallicFactor=0,
    RoughnessFactor=1,
    EmissiveFactor=RGB(0, 0, 0),
    AlphaMode="BLEND",
    AlphaCutoff=0.5,
    DoubleSided=True)
polyline_4 = PolyLine(Vertices=trim_tree_4, Closed=False)  # -> flatten(Polyline)
constructattr = ConstructAttributes(Keys="material", Values=gltf2material)
plane = Plane(bounding_rectangle.Bounding)
export3dm = _3dmExportOptions(Version=7, N=False)
scale_nu = ScaleNU(Geometry=bounding_rectangle.Bounding, Plane=plane, ScaleX=1.7, ScaleY=2, ScaleZ=1)  # -> Geometry, Transform
injectattr = InjectAttributes(Object=polyline_4, Attributes=constructattr)  # -> flatten(Object)
printingpath = DownloadExport(Data=polyline_4, Options=export3dm, Name="printingPath")
divisions_color_2 = ColourSwatch(SwatchColor=RGBA(255, 0, 0, 142))
cull_index_5 = CullIndex(List=flatten(scale_nu.Geometry), Indices=0, Wrap=True)
gltf2material_2 = GlTF20Material(
    BaseColorFactor=divisions_color_2,
    MetallicFactor=0,
    RoughnessFactor=1,
    EmissiveFactor=RGB(0, 0, 0),
    AlphaMode="BLEND",
    AlphaCutoff=0.5,
    DoubleSided=True)
mesh_plane = MeshPlane(Boundary=cull_index_5, WidthCount=1, HeightCount=1)  # -> Mesh, Area
constructattr_2 = ConstructAttributes(Keys="material", Values=gltf2material_2)
injectattr_2 = InjectAttributes(Object=mesh_plane.Mesh, Attributes=constructattr_2)  # -> flatten(Object)
printingpath_2 = GlTF20Display(Geometry=[injectattr, injectattr_2])

# ==== cluster Cluster
span = ClusterInput()
span_2 = Data(span)
number_slider = Slider(5000, range=3000..10000)
pt = Point("0,0,0")
expression = Expression(x=span_2, y="45", Expression="Ceiling(x/y/50)*50")
expression_2 = Expression(x=span_2, y="15", Expression="Ceiling(x/y/50)*50")
X = UnitX(Factor=span_2)
max = Maximum(A=expression, B="400")
max_2 = Maximum(A=expression_2, B="500")
addition = Addition(A=pt, B=X)
avr = Average(Input=[pt, addition])
Z = UnitZ(Factor="100")
bridge_section = BridgeSection(W=number_slider, h_min=max, h_max=max_2, e="250", b="500")  # -> C, top_curve_2, bottom_curve_2
bridge_section_2 = BridgeSection(W=number_slider, h_min="400", h_max=max, e="250", b="500")  # -> C, top_curve_2, bottom_curve_2
addition_2 = Addition(A=avr, B=Z)
pt_2 = Point(pt)
pt_3 = Point(addition_2)
pt_4 = Point(addition)
xy = XYPlane(Origin=Point(0, 0, 0))
yz = YZPlane(Origin=Point(0, 0, 0))
yz_2 = YZPlane(Origin=pt_4)
yz_3 = YZPlane(Origin=avr)
arc = Arc3Pt(PointA=pt_2, PointB=pt_3, PointC=pt_4)  # -> Arc, Plane, Radius
orient = Orient(Geometry=bridge_section_2.C, Source=xy, Target=yz_3)  # -> Geometry, Transform
orient_2 = Orient(Geometry=bridge_section.C, Source=xy, Target=yz)  # -> Geometry, Transform
orient_3 = Orient(Geometry=bridge_section.C, Source=xy, Target=yz_2)  # -> Geometry, Transform
orient_4 = Orient(Geometry=bridge_section.top_curve_2, Source=xy, Target=yz)  # -> Geometry, Transform
orient_5 = Orient(Geometry=bridge_section.top_curve_2, Source=xy, Target=yz_2)  # -> Geometry, Transform
orient_6 = Orient(Geometry=bridge_section.bottom_curve_2, Source=xy, Target=yz_2)  # -> Geometry, Transform
orient_7 = Orient(Geometry=bridge_section.bottom_curve_2, Source=xy, Target=yz)  # -> Geometry, Transform
orient_8 = Orient(Geometry=bridge_section_2.bottom_curve_2, Source=xy, Target=yz_3)  # -> Geometry, Transform
orient_9 = Orient(Geometry=bridge_section_2.top_curve_2, Source=xy, Target=yz_3)  # -> Geometry, Transform
X_2 = UnitX(Factor="250")
neg = Negative(Value=X_2)
tc3 = Curve(orient_5.Geometry)
bc3 = Curve(orient_6.Geometry)
bc1 = Curve(orient_7.Geometry)
tc2 = Curve(orient_9.Geometry)
tc1 = Curve(orient_4.Geometry)
bc2 = Curve(orient_8.Geometry)
move = Move(Geometry=orient_3.Geometry, Motion=neg)  # -> Geometry, Transform
move_2 = Move(Geometry=orient_2.Geometry, Motion=X_2)  # -> Geometry, Transform
move_3 = Move(Geometry=orient_2.Geometry, Motion=neg)  # -> Geometry, Transform
move_4 = Move(Geometry=orient_3.Geometry, Motion=X_2)  # -> Geometry, Transform
hend = Data(max_2)
hmid = Data(max)
tc3_2 = ClusterOutput(tc3)
bc3_2 = ClusterOutput(bc3)
bc1_2 = ClusterOutput(bc1)
tc2_2 = ClusterOutput(tc2)
tc1_2 = ClusterOutput(tc1)
bc2_2 = ClusterOutput(bc2)
hend_2 = ClusterOutput(hend)
hmid_2 = ClusterOutput(hmid)
loft = Loft(
    Curves=[move_2.Geometry, move_3.Geometry],
    Options={Adjust=False, Closed=False, LoftEnds=0, LoftSimp=0, LoftType=1, Rebuild=10, Refit=0.01})
loft_2 = Loft(
    Curves=[move.Geometry, move_4.Geometry],
    Options={Adjust=False, Closed=False, LoftEnds=0, LoftSimp=0, LoftType=1, Rebuild=10, Refit=0.01})
loft_3 = Loft(
    Curves=[move_2.Geometry, orient.Geometry, move.Geometry],
    Options={Adjust=False, Closed=False, LoftEnds=0, LoftSimp=0, LoftType=2, Rebuild=10, Refit=0.01})
bridge = Brep(loft_3)
joint1 = Brep(loft)
joint2 = Brep(loft_2)
bridge_2 = ClusterOutput(bridge)
joint1_2 = ClusterOutput(joint1)
joint2_2 = ClusterOutput(joint2)

# ==== cluster BridgeSection
W = ClusterInput()
h_min = ClusterInput()
h_max = ClusterInput()
e = ClusterInput()
b = ClusterInput()
W_2 = Data(W)
h_min_2 = Data(h_min)
h_max_2 = Data(h_max)
e_2 = Data(e)
pt = Point("0,0,0")
b_2 = Data(b)
Y = UnitY(Factor="25")
neg = Negative(Value=h_min_2)
neg_2 = Negative(Value=e_2)
neg_3 = Negative(Value=h_max_2)
neg_4 = Negative(Value=b_2)
division = Division(A=W_2, B=2)
neg_5 = Negative(Value=Y)
Y_2 = UnitY(Factor=neg)
X = UnitX(Factor=division)
expression = Expression(x=neg_2, y=neg_4, Expression="x*2+y")
X_2 = UnitX(Factor=expression)
addition = Addition(A=pt, B=X, C=neg_5)
X_3 = UnitX(Factor=neg_2)
Y_3 = UnitY(Factor=neg_3)
X_4 = UnitX(Factor=neg_4)
addition_2 = Addition(A=X_2, B=X)
addition_3 = Addition(A=addition, B=X_3, C=Y_3)
addition_4 = Addition(A=Y_2, B=addition_2)
addition_5 = Addition(A=addition_3, B=X_4)
yz = YZPlane(Origin=Point(0, 0, 0))
pt_2 = Point(addition)
pt_3 = Point(pt)
pt_4 = Point(addition_3)
pt_5 = Point(addition_5)
pt_6 = Point(addition_4)
pt_7 = Point(Y_2)
merge = Merge(Data1=pt_3, Data2=pt_2, Data3=pt_4, Data4=pt_5, Data5=pt_6, Data6=pt_7)
pline = PolyLine(Vertices=merge, Closed=False)
mirror = Mirror(Geometry=pline, Plane=yz)  # -> Geometry, Transform
transform = Transform(Geometry=pt_6, Transform=mirror.Transform)
transform_2 = Transform(Geometry=pt_5, Transform=mirror.Transform)
transform_3 = Transform(Geometry=pt_4, Transform=mirror.Transform)
merge_2 = Merge(Data1=pt_4, Data2=pt_5, Data3=pt_6, Data4=pt_7, Data5=transform, Data6=transform_2, Data7=transform_3)
rad = Radians()
pline_2 = PolyLine(Vertices=merge_2, Closed=False)
intcrv = Interpolate(Vertices=merge_2, Degree=3, Periodic=False, KnotStyle=1)  # -> Curve, Length, Domain
transform_4 = Transform(Geometry=pt_2, Transform=mirror.Transform)
mirror_2 = Mirror(Geometry=pline, Plane=yz)  # -> Geometry, Transform
arc = Arc3Pt(PointA=pt_2, PointB=pt_3, PointC=transform_4)  # -> Arc, Plane, Radius
bottom_curve = Curve(intcrv.Curve)
end = EndPoints(Curve=intcrv.Curve)  # -> Start, End
end_2 = EndPoints(Curve=arc.Arc)  # -> Start, End
top_curve = Curve(arc.Arc)
ln = Line(StartPoint=end_2.End, EndPoint=end.End)
ln_2 = Line(StartPoint=end_2.Start, EndPoint=end.Start)
top_curve_2 = ClusterOutput(top_curve)
bottom_curve_2 = ClusterOutput(bottom_curve)
join = JoinCurves(Curves=flatten([ln_2, bottom_curve, top_curve, ln]), Preserve=False)
C = ClusterOutput(join)
