# Grasshopper definition AEC Tech Barcelona Hackaton - Bridge.gh (Grasshopper 1.0.7)
# plug-ins: GrasshopperHyperGooComponents, ShapeDiverForGrasshopper, jSwan

multiplier = Slider(1000, range=0..10000)
span = Slider(25000, range=5000..100000)
listofelevations = DirectTextInput(maxlength=10000, text="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")
dejson = DeserializeJson(JSON=listofelevations, OutputsLocked=True)
dejson_2 = DeserializeJson(JSON=dejson, OutputsLocked=True)
multiplication = Multiplication(A=multiplier, B=dejson_2)
num2pt = NumbersToPoints(Numbers=multiplication, Mask=4)  # -> flatten(Points)

# ----
# Extract start and end points, add 1000mm to the highest point to raise the bridge
# Get terrain curve from points
pdecon = Deconstruct(Point=num2pt)  # -> XComponent, YComponent, ZComponent
pline = PolyLine(Vertices=num2pt, Closed=False)
sort = SortList(Keys=pdecon.ZComponent)  # -> reverse(Keys), ValuesA
item = ListItem(List=sort.Keys, Index=0, Wrap=True)
addition = Addition(A=item, B=1000)
pt = ConstructPoint(XCoordinate=pdecon.XComponent, YCoordinate=pdecon.YComponent, ZCoordinate=addition)
item_2 = ListItem(List=pt, Index=0, Wrap=True)  # -> Item1, Item
terrain = Curve(reparameterize(pline))
start_point = Point(item_2.Item)
end_point = Point(item_2.Item1)

# ----
# Generate bridge span points and intersect with terrain curve
start_point_2 = Point(start_point)
end_point_2 = Point(end_point)
terrain_2 = Curve(reparameterize(terrain))
L = Data(span)
ln = Line(StartPoint=start_point_2, EndPoint=end_point_2)
len = Length(Curve=ln)
expression = Expression(x=len, y=L, Expression="ceiling(x/y)")
pframes = PerpFrames(Curve=ln, Count=expression, Align=True)  # -> Frames, Parameters
division = Division(A=len, B=expression)
pcx = CurvePlane(Curve=terrain_2, Plane=pframes.Frames)  # -> flatten(Points), ParamsC, ParamsP
dist = Distance(PointA=pframes.Frames, PointB=pcx.Points)
span_2 = Data(flatten(division))
pier_heights = Data(dist)
pt_2 = Point(pframes.Frames)

pt_3 = Point(pt_2)
span_3 = Data(flatten(span_2))
pt_4 = Point(Point(0, 0, 0))
expression_2 = Expression(x=span_3, y="45", Expression="Ceiling(x/y/50)*50")
expression_3 = Expression(x=span_3, y="15", Expression="Ceiling(x/y/50)*50")
X = UnitX(Factor=span_3)
shift = ShiftList(List=pt_2, Shift=1, Wrap=False)
shift_2 = ShiftList(List=pt_2, Shift=-1, Wrap=False)
addition_2 = Addition(A=pt_4, B=X)
max = Maximum(A=expression_2, B="400")
max_2 = Maximum(A=expression_3, B="500")
avr = Average(Input=flatten([pt_4, addition_2]))
pt_5 = Point(addition_2)
bridge_section = BridgeSection(W="5000", h_min=max, h_max=max_2, e="250", b="500")  # -> top_curve_2, C, bottom_curve_2
bridge_section_2 = BridgeSection(W="5000", h_min="400", h_max=max, e="250", b="500")  # -> top_curve_2, C, bottom_curve_2
yz = YZPlane(Origin=pt_5)
xy = XYPlane(Origin=Point(0, 0, 0))
yz_2 = YZPlane(Origin=Point(0, 0, 0))
yz_3 = YZPlane(Origin=avr)
X_2 = UnitX(Factor="250")
orient = Orient(Geometry=bridge_section_2.C, Source=xy, Target=yz_3)  # -> Geometry, Transform
orient_2 = Orient(Geometry=bridge_section.C, Source=xy, Target=yz_2)  # -> Geometry, Transform
orient_3 = Orient(Geometry=bridge_section.C, Source=xy, Target=yz)  # -> Geometry, Transform
neg = Negative(Value=X_2)
move = Move(Geometry=orient_2.Geometry, Motion=X_2)  # -> Geometry, Transform
move_2 = Move(Geometry=orient_2.Geometry, Motion=neg)  # -> Geometry, Transform
move_3 = Move(Geometry=orient_3.Geometry, Motion=neg)  # -> Geometry, Transform
move_4 = Move(Geometry=orient_3.Geometry, Motion=X_2)  # -> Geometry, Transform
hend = Data(max_2)
loft = Loft(
    Curves=[move.Geometry, orient.Geometry, move_3.Geometry],
    Options={Adjust=False, Closed=False, LoftEnds=0, LoftSimp=0, LoftType=2, Rebuild=10, Refit=0.01})
loft_2 = Loft(
    Curves=[move.Geometry, move_2.Geometry],
    Options={Adjust=False, Closed=False, LoftEnds=0, LoftSimp=0, LoftType=1, Rebuild=10, Refit=0.01})
loft_3 = Loft(
    Curves=[move_3.Geometry, move_4.Geometry],
    Options={Adjust=False, Closed=False, LoftEnds=0, LoftSimp=0, LoftType=1, Rebuild=10, Refit=0.01})
bridge = Brep(loft)
joint1 = Brep(loft_2)
joint2 = Brep(loft_3)
hend_2 = Data(hend)
xy_2 = XYPlane(Origin=Point(0, 0, 0))
vec2pt = Vector2Pt(PointA=shift_2, PointB=shift, Unitize=False)  # -> Vector, Length
Z = UnitZ(Factor=hend_2)
join = BrepJoin(Breps=[bridge, joint1, joint2])  # -> Breps, Closed
align = AlignPlane(Plane=xy_2, Direction=vec2pt.Vector)  # -> Plane, Angle
cap = CapHoles(Brep=join.Breps)
pl_origin = PlaneOrigin(Base=align.Plane, Origin=shift_2)
pi = Pi(Factor=0.5)
item_3 = ListItem(List=align.Angle, Index=0, Wrap=True)
mesh = MeshBrep(
    Brep=cap,
    Settings={GridMaxCount=0, GridMinCount=16, JaggedSeams=False, MaxEdgeLength=0, MinEdgeLength=0.0001, MinTolerance=0, Refine=True, RefineAngle=0, RelativeTolerance=0.65, SimplePlanes=True, Tolerance=0})
orient_4 = Orient(Source=PlaneXY(0, 0, 0), Target=pl_origin)  # -> Geometry, Transform
addition_3 = Addition(A=item_3, B=pi)
move_5 = Move(Geometry=mesh, Motion=Z)  # -> Geometry, Transform
cluster = Cluster(point=pt_3, data=pier_heights, rotation=addition_3)  # -> mesh_4, mesh_5
attachtransform = AttachTransformations(Geometry=move_5.Geometry, Transform=orient_4.Transform)
transform = Transform(Geometry=move_5.Geometry, Transform=orient_4.Transform)
merge = Merge(Data1=transform, Data2=cluster.mesh_5)  # -> flatten(Result)
merge_2 = Merge(Data1=attachtransform, Data2=cluster.mesh_4)  # -> flatten(Result)
export3dm = _3dmExportOptions(Version=7, N=False)
bridgeexport = DownloadExport(Data=merge, Options=export3dm, Name="bridge")
bridge_2 = GlTF20Display(Geometry=merge_2)

# ==== cluster BridgeSection
W = ClusterInput()
h_min = ClusterInput()
h_max = ClusterInput()
e = ClusterInput()
b = ClusterInput()
W_2 = Data(W)
h_min_2 = Data(h_min)
h_max_2 = Data(h_max)
pt = Point(Point(0, 0, 0))
e_2 = Data(e)
b_2 = Data(b)
neg = Negative(Value=h_min_2)
neg_2 = Negative(Value=e_2)
neg_3 = Negative(Value=h_max_2)
neg_4 = Negative(Value=b_2)
division = Division(A=W_2, B=2)
Y = UnitY(Factor=neg)
X = UnitX(Factor=division)
expression = Expression(x=neg_2, y=neg_4, Expression="x*2+y")
Y_2 = UnitY(Factor=-25)
X_2 = UnitX(Factor=expression)
addition = Addition(A=pt, B=X, C=Y_2)
X_3 = UnitX(Factor=neg_2)
Y_3 = UnitY(Factor=neg_3)
X_4 = UnitX(Factor=neg_4)
addition_2 = Addition(A=X_2, B=X)
addition_3 = Addition(A=addition, B=X_3, C=Y_3)
addition_4 = Addition(A=Y, B=addition_2)
addition_5 = Addition(A=addition_3, B=X_4)
pt_2 = Point(addition)
pt_3 = Point(pt)
pt_4 = Point(addition_3)
pt_5 = Point(addition_5)
pt_6 = Point(addition_4)
pt_7 = Point(Y)
merge = Merge(Data1=pt_3, Data2=pt_2, Data3=pt_4, Data4=pt_5, Data5=pt_6, Data6=pt_7)
pline = PolyLine(Vertices=merge, Closed=False)
mirror = Mirror(Geometry=pline, Plane=PlaneYZ(0, 0, 0))  # -> Geometry, Transform
transform = Transform(Geometry=pt_6, Transform=mirror.Transform)
transform_2 = Transform(Geometry=pt_5, Transform=mirror.Transform)
transform_3 = Transform(Geometry=pt_4, Transform=mirror.Transform)
merge_2 = Merge(Data1=pt_4, Data2=pt_5, Data3=pt_6, Data4=pt_7, Data5=transform, Data6=transform_2, Data7=transform_3)
intcrv = Interpolate(Vertices=merge_2, Degree=3, Periodic=False, KnotStyle=1)  # -> Curve, Length, Domain
transform_4 = Transform(Geometry=pt_2, Transform=mirror.Transform)
arc = Arc3Pt(PointA=pt_2, PointB=pt_3, PointC=transform_4)  # -> Arc, Plane, Radius
bottom_curve = Curve(intcrv.Curve)
end = EndPoints(Curve=intcrv.Curve)  # -> Start, End
end_2 = EndPoints(Curve=arc.Arc)  # -> Start, End
top_curve = Curve(arc.Arc)
ln = Line(StartPoint=end_2.End, EndPoint=end.End)
ln_2 = Line(StartPoint=end_2.Start, EndPoint=end.Start)
top_curve_2 = ClusterOutput(top_curve)
bottom_curve_2 = ClusterOutput(bottom_curve)
join = JoinCurves(Curves=flatten([ln_2, bottom_curve, top_curve, ln]), Preserve=False)
C = ClusterOutput(join)

# ==== cluster Cluster
point = ClusterInput()
data = ClusterInput()
depth_of_footing = Slider(1500, range=500..2500)
offset_of_pile_from_column_face = Slider(500, range=50..500)
ht_of_piles = Slider(5000, range=3000..12000)
vertical_length_y = Slider(2000, range=1000..6000)
point_2 = Point(point)
horizontal_length_x = Slider(4500, range=1000..8000)
side_width_yy = Slider(500, range=500..1500)
graft = GraftTree(Tree=point_2, IncludeEmptyLists=True, IncludeNullItems=True)
data_2 = Data(graft(data))
unit_y = UnitY(Factor=expr("x/2", side_width_yy))
unit_x = UnitX(Factor=expr("-x/2", horizontal_length_x))
unit_y_2 = UnitY(Factor=expr("-x/2", side_width_yy))
unit_y_3 = UnitY(Factor=expr("-x/2", vertical_length_y))
unit_y_4 = UnitY(Factor=expr("x/2", vertical_length_y))
from_topography = Point(graft)
move = Move(Geometry=from_topography, Motion=unit_x)  # -> Geometry, Transform
move_2 = Move(Geometry=move.Geometry, Motion=unit_y)  # -> Geometry, Transform
move_3 = Move(Geometry=move.Geometry, Motion=unit_y_2)  # -> Geometry, Transform
move_4 = Move(Geometry=from_topography, Motion=unit_y_4)  # -> Geometry, Transform
move_5 = Move(Geometry=from_topography, Motion=unit_y_3)  # -> Geometry, Transform
unit_y_5 = UnitY(Factor=expr("x/2", side_width_yy))
unit_x_2 = UnitX(Factor=expr("x/2", horizontal_length_x))
unit_y_6 = UnitY(Factor=expr("-x/2", side_width_yy))
move_6 = Move(Geometry=from_topography, Motion=unit_x_2)  # -> Geometry, Transform
move_7 = Move(Geometry=move_6.Geometry, Motion=unit_y_5)  # -> Geometry, Transform
move_8 = Move(Geometry=move_6.Geometry, Motion=unit_y_6)  # -> Geometry, Transform

# ---- group: Pier / Profile of column at top
profile_of_column = PolyLine(
    Vertices=[move_2.Geometry, move_3.Geometry, move_5.Geometry, move_8.Geometry, move_7.Geometry, move_4.Geometry],
    Closed=True)

# ----
xy = XYPlane(Origin=Point(0, 0, 0))

# ---- group: Footing
unit_z = UnitZ(Factor=expr("-x-150", data_2))
construct_domain = ConstructDomain(DomainStart=expr("-x/2", horizontal_length_x), DomainEnd=expr("x/2", horizontal_length_x))
construct_domain_2 = ConstructDomain(DomainStart=expr("-x/2", vertical_length_y), DomainEnd=expr("(x/2)", vertical_length_y))
unit_z_2 = UnitZ(Factor=expr("-x", depth_of_footing))
rectangle = Rectangle(Plane=xy, XSize=construct_domain, YSize=construct_domain_2, Radius=0)  # -> Rectangle, Length
offset_curve = OffsetCurve(Curve=rectangle.Rectangle, Distance=583.0951895, Corners=1)
boundary_surfaces = BoundarySurfaces(Edges=offset_curve)
extrude = Extrude(Base=boundary_surfaces, Direction=unit_z_2)

# ---- group: Piles
polyline = PolyLine(Vertices=[move.Geometry, move_4.Geometry, move_6.Geometry, move_5.Geometry], Closed=True)
offset_curve_2 = OffsetCurve(Curve=offset_curve, Distance=expr("-x", offset_of_pile_from_column_face), Corners=1)
explode = Explode(Curve=offset_curve_2, Recursive=True)  # -> Segments, Vertices
unit_z_3 = UnitZ(Factor=expr("-x", depth_of_footing))
unit_z_4 = UnitZ(Factor=expr("-x", ht_of_piles))
move_9 = Move(Geometry=explode.Vertices, Motion=unit_z_3)  # -> Geometry, Transform
move_10 = Move(Geometry=move_9.Geometry, Motion=unit_z_4)  # -> Geometry, Transform
line = Line(StartPoint=move_9.Geometry, EndPoint=move_10.Geometry)
pipe = Pipe(Curve=line, Radius=200, Caps=1)  # -> simplify(Pipe)

# ----
addition = Addition(A=graft, B=unit_z)

# ---- group: Pier
unit_z_5 = UnitZ(Factor=expr("-x", data_2))
move_11 = Move(Geometry=profile_of_column, Motion=Vector(0, 0, -150))  # -> Geometry, Transform
offset_curve_3 = OffsetCurve(Curve=move_11.Geometry, Distance=300, Corners=1)
move_12 = Move(Geometry=offset_curve_3, Motion=unit_z_5)  # -> Geometry, Transform

# ----
rotation = ClusterInput()
rotation_2 = Number(rotation)
trim_tree = TrimTree(Tree=move_12.Geometry, Depth=1)
loftmesh = LoftMesh(Polylines=[move_11.Geometry, trim_tree], ComputeUV=False, IsometricUV=False, UVSize=1)
pline2msh = PolylineToMesh(Polyline=move_11.Geometry, Quadrangulate=True)
merge = Merge(Data1=extrude, Data2=pipe)
jagged = SettingsSpeed()
flip = MeshFlip(Mesh=pline2msh)
unweld = UnweldMesh(Mesh=loftmesh, Angle=0)
mesh = MeshBrep(Brep=merge, Settings=jagged)  # -> flatten(Mesh)
move_13 = Move(Motion=flatten(addition))  # -> Geometry, Transform
merge_2 = Merge(Data1=flip, Data2=unweld)
mjoin = MeshJoin(Meshes=mesh)
mjoin_2 = MeshJoin(Meshes=merge_2)  # -> flatten(Mesh)
rotate = Rotate(Geometry=mjoin, Angle=rotation_2, Plane=PlaneXY(0, 0, 0))  # -> Geometry, Transform
rotate_2 = Rotate(Geometry=mjoin_2, Angle=rotation_2, Plane=point_2)  # -> Geometry, Transform
transform = Transform(Geometry=rotate.Geometry, Transform=move_13.Transform)
attachtransform = AttachTransformations(Geometry=rotate.Geometry, Transform=move_13.Transform)
merge_3 = Merge(Data1=rotate_2.Geometry, Data2=attachtransform)  # -> flatten(Result)
merge_4 = Merge(Data1=rotate_2.Geometry, Data2=transform)  # -> flatten(Result)
mesh_2 = Mesh(merge_3)
mesh_3 = Mesh(merge_4)
mesh_4 = ClusterOutput(mesh_2)
mesh_5 = ClusterOutput(mesh_3)
