# Grasshopper definition AEC Tech Barcelona Hackaton - Get Route Data.gh (Grasshopper 1.0.7)
# plug-ins: Swiftlet, ShapeDiverForGrasshopper, Pufferfish

with_bridge = BooleanToggle(False)

# ---- group: Bridge
# BRIDGE
start_point_bridge_lon = DirectTextInput(maxlength=10000, text="4.17895786078317")
start_point_bridge_lat = DirectTextInput(maxlength=10000, text="51.9340224318266")
end_point_bridge_lon = DirectTextInput(maxlength=10000, text="4.19676568061054")
end_point_bridge_lat = DirectTextInput(maxlength=10000, text="51.9482023553841")
pt = ConstructPoint(XCoordinate=start_point_bridge_lon, YCoordinate=start_point_bridge_lat, ZCoordinate=0)
pt_2 = ConstructPoint(XCoordinate=end_point_bridge_lon, YCoordinate=end_point_bridge_lat, ZCoordinate=0)
pt_3 = Point(pt_2)
pt_4 = Point(pt)
start = Point(pt_4)
end = Point(pt_3)

# ---- group: Navigation
# COFFEE LOVER HOME
# COFFEE SHOP
start_point_lon = DirectTextInput(maxlength=10000, text="4.18408751531352")
start_point_lat = DirectTextInput(maxlength=10000, text="51.921719120908")
end_point_lon = DirectTextInput(maxlength=10000, text="4.21225597636619")
end_point_lat = DirectTextInput(maxlength=10000, text="51.9453287155851")
pt_5 = ConstructPoint(XCoordinate=start_point_lon, YCoordinate=start_point_lat, ZCoordinate=0)
pt_6 = ConstructPoint(XCoordinate=end_point_lon, YCoordinate=end_point_lat, ZCoordinate=0)
pt_7 = Point(pt_5)
pt_8 = Point(pt_6)
start_2 = Point(pt_7)
end_2 = Point(pt_8)

# ----
ln = Line(StartPoint=pt_4, EndPoint=pt_3)
merge = Merge(Data1=start, Data2=end)

# ---- group: get url
panel = Panel("http://router.project-osrm.org/route/v1/foot/start_lon,start_lat;end_lon,end_lat")
pdecon = Deconstruct(Point=pt_7)  # -> XComponent, YComponent, ZComponent
pdecon_2 = Deconstruct(Point=pt_8)  # -> XComponent, YComponent, ZComponent
rep = ReplaceText(Text=panel, Find="start_lon", Replace=pdecon.XComponent, RecursiveReplace=False)
rep_2 = ReplaceText(Text=rep, Find="start_lat", Replace=pdecon.YComponent, RecursiveReplace=False)
rep_3 = ReplaceText(Text=rep_2, Find="end_lon", Replace=pdecon_2.XComponent, RecursiveReplace=False)
rep_4 = ReplaceText(Text=rep_3, Find="end_lat", Replace=pdecon_2.YComponent, RecursiveReplace=False)

# ----
dist = Distance(PointA=start_2, PointB=merge)
sort = SortList(Keys=dist, ValuesA=merge)  # -> Keys, ValuesA
item = ListItem(List=sort.ValuesA, Index=0, Wrap=True)  # -> Item, Item1
start_3 = Point(pt_7)
end_3 = Point(item.Item)

# ---- group: get url
panel_2 = Panel("http://router.project-osrm.org/route/v1/foot/start_lon,start_lat;end_lon,end_lat")
pdecon_3 = Deconstruct(Point=start_3)  # -> XComponent, YComponent, ZComponent
pdecon_4 = Deconstruct(Point=end_3)  # -> XComponent, YComponent, ZComponent
rep_5 = ReplaceText(Text=panel_2, Find="start_lon", Replace=pdecon_3.XComponent, RecursiveReplace=False)
rep_6 = ReplaceText(Text=rep_5, Find="start_lat", Replace=pdecon_3.YComponent, RecursiveReplace=False)
rep_7 = ReplaceText(Text=rep_6, Find="end_lon", Replace=pdecon_4.XComponent, RecursiveReplace=False)
rep_8 = ReplaceText(Text=rep_7, Find="end_lat", Replace=pdecon_4.YComponent, RecursiveReplace=False)

# ----
start_4 = Point(end_2)
end_4 = Point(item.Item1)

# ---- group: get url
panel_3 = Panel("http://router.project-osrm.org/route/v1/foot/start_lon,start_lat;end_lon,end_lat")
pdecon_5 = Deconstruct(Point=start_4)  # -> XComponent, YComponent, ZComponent
pdecon_6 = Deconstruct(Point=end_4)  # -> XComponent, YComponent, ZComponent
rep_9 = ReplaceText(Text=panel_3, Find="start_lon", Replace=pdecon_5.XComponent, RecursiveReplace=False)
rep_10 = ReplaceText(Text=rep_9, Find="start_lat", Replace=pdecon_5.YComponent, RecursiveReplace=False)
rep_11 = ReplaceText(Text=rep_10, Find="end_lon", Replace=pdecon_6.XComponent, RecursiveReplace=False)
rep_12 = ReplaceText(Text=rep_11, Find="end_lat", Replace=pdecon_6.YComponent, RecursiveReplace=False)

# ---- group: request
cqp = CreateQueryParam(Key="overview", Value="false")
cqp_2 = CreateQueryParam(Key="steps", Value="true")
get = GETRequest(URL=rep_4, Params=[cqp, cqp_2])  # -> Status, Content, Response

# ---- group: decode json
pjs = ParseJSONString(Text=get.Content)
gjok = GetJSONObjectKey(JObject=pjs, Key="routes")
rja = ReadJSONArray(Array=gjok)
gjok_2 = GetJSONObjectKey(JObject=rja, Key="legs")
rja_2 = ReadJSONArray(Array=gjok_2)
item_2 = ListItem(List=rja_2, Index=0, Wrap=True)
gjok_3 = GetJSONObjectKey(JObject=item_2, Key="steps")
rja_3 = ReadJSONArray(Array=gjok_3)
gjok_4 = GetJSONObjectKey(JObject=rja_3, Key="intersections")
rja_4 = ReadJSONArray(Array=gjok_4)
gjok_5 = GetJSONObjectKey(JObject=rja_4, Key="location")
rja_5 = ReadJSONArray(Array=gjok_5)
rjv = ReadJSONValue(JValue=rja_5)  # -> AsString, AsNumber, AsBool

# ---- group: request
cqp_3 = CreateQueryParam(Key="overview", Value="false")
cqp_4 = CreateQueryParam(Key="steps", Value="true")
get_2 = GETRequest(URL=rep_8, Params=[cqp_3, cqp_4])  # -> Status, Content, Response

cqp_5 = CreateQueryParam(Key="overview", Value="false")
cqp_6 = CreateQueryParam(Key="steps", Value="true")
get_3 = GETRequest(URL=rep_12, Params=[cqp_5, cqp_6])  # -> Status, Content, Response

# ---- group: decode json
pjs_2 = ParseJSONString(Text=get_2.Content)
gjok_6 = GetJSONObjectKey(JObject=pjs_2, Key="routes")
rja_6 = ReadJSONArray(Array=gjok_6)
gjok_7 = GetJSONObjectKey(JObject=rja_6, Key="legs")
rja_7 = ReadJSONArray(Array=gjok_7)
item_3 = ListItem(List=rja_7, Index=0, Wrap=True)
gjok_8 = GetJSONObjectKey(JObject=item_3, Key="steps")
rja_8 = ReadJSONArray(Array=gjok_8)
gjok_9 = GetJSONObjectKey(JObject=rja_8, Key="intersections")
rja_9 = ReadJSONArray(Array=gjok_9)
gjok_10 = GetJSONObjectKey(JObject=rja_9, Key="location")
rja_10 = ReadJSONArray(Array=gjok_10)
rjv_2 = ReadJSONValue(JValue=rja_10)  # -> AsString, AsNumber, AsBool

pjs_3 = ParseJSONString(Text=get_3.Content)
gjok_11 = GetJSONObjectKey(JObject=pjs_3, Key="routes")
rja_11 = ReadJSONArray(Array=gjok_11)
gjok_12 = GetJSONObjectKey(JObject=rja_11, Key="legs")
rja_12 = ReadJSONArray(Array=gjok_12)
item_4 = ListItem(List=rja_12, Index=0, Wrap=True)
gjok_13 = GetJSONObjectKey(JObject=item_4, Key="steps")
rja_13 = ReadJSONArray(Array=gjok_13)
gjok_14 = GetJSONObjectKey(JObject=rja_13, Key="intersections")
rja_14 = ReadJSONArray(Array=gjok_14)
gjok_15 = GetJSONObjectKey(JObject=rja_14, Key="location")
rja_15 = ReadJSONArray(Array=gjok_15)
rjv_3 = ReadJSONValue(JValue=rja_15)  # -> AsString, AsNumber, AsBool

# ----
gjok_16 = GetJSONObjectKey(JObject=item_2, Key="distance")
rjv_4 = ReadJSONValue(JValue=gjok_16)  # -> AsString, AsNumber, AsBool
division = Division(A=rjv_4.AsNumber, B="1000")
round = Round(Number=division)  # -> Nearest, Floor, Ceiling
panel_4 = Panel(rjv_4.AsNumber)

gjok_17 = GetJSONObjectKey(JObject=item_3, Key="distance")
rjv_5 = ReadJSONValue(JValue=gjok_17)  # -> AsString, AsNumber, AsBool
division_2 = Division(A=rjv_5.AsNumber, B="1000")
panel_5 = Panel(rjv_5.AsNumber)

# ---- group: generate route
item_5 = ListItem(List=rjv.AsNumber, Index=0, Wrap=True)  # -> Item, Item1
pt_9 = ConstructPoint(XCoordinate=item_5.Item, YCoordinate=item_5.Item1, ZCoordinate=0)
route_points = Point(flatten(pt_9))
start_5 = Point(start_2)
end_5 = Point(end_2)
ins = InsertItems(List=route_points, Item=start_5, Indices="0", Wrap=True)
ins_2 = InsertItems(List=ins, Item=end_5, Indices="-1", Wrap=True)

item_6 = ListItem(List=rjv_2.AsNumber, Index=0, Wrap=True)  # -> Item, Item1
pt_10 = ConstructPoint(XCoordinate=item_6.Item, YCoordinate=item_6.Item1, ZCoordinate=0)
route_points_2 = Point(flatten(pt_10))
start_6 = Point(start_3)
end_6 = Point(end_3)
ins_3 = InsertItems(List=route_points_2, Item=start_6, Indices="0", Wrap=True)
ins_4 = InsertItems(List=ins_3, Item=end_6, Indices="-1", Wrap=True)

item_7 = ListItem(List=rjv_3.AsNumber, Index=0, Wrap=True)  # -> Item, Item1
pt_11 = ConstructPoint(XCoordinate=item_7.Item, YCoordinate=item_7.Item1, ZCoordinate=0)
route_points_3 = Point(flatten(pt_11))
start_7 = Point(start_4)
end_7 = Point(end_4)
ins_5 = InsertItems(List=route_points_3, Item=start_7, Indices="0", Wrap=True)
ins_6 = InsertItems(List=ins_5, Item=end_7, Indices="-1", Wrap=True)

# ----
entwine = Entwine(Branch00=ins_4, Branch01=ins_6, FlattenInputs=True)
filter = StreamFilter(Gate=with_bridge, Stream0=ins_2, Stream1=entwine)
filter_2 = StreamFilter(Gate=with_bridge, Stream1=ln)
viewer = ParamViewer(filter)
pline = PolyLine(Vertices=filter, Closed=False)  # -> flatten(Polyline)
listdexs = ListIndices(List=viewer)
concat = Concatenate(FragmentA="[", FragmentB=listdexs, FragmentC="]")
merge_2 = Merge(Data1=filter_2, Data2=pline)
constructjson = ConstructJSON(Data=filter, AddressString=concat)
export3dm = _3dmExportOptions(Version=7, N=False)
join = JoinCurves(Curves=merge_2, Preserve=False)
path = DirectDataOutput(Data=constructjson)
downloadpath = DownloadExport(Data=join, Options=export3dm, Name="path")
redpline = Reduce(Polyline=join, Tolerance=0.001)  # -> Polyline, Reduction
explode = Explode(Curve=redpline.Polyline, Recursive=True)  # -> Segments, Vertices
end_8 = EndPoints(Curve=explode.Segments)  # -> Start, End
pdecon_7 = Deconstruct(Point=end_8.Start)  # -> XComponent, YComponent, ZComponent
pdecon_8 = Deconstruct(Point=end_8.End)  # -> XComponent, YComponent, ZComponent
ch = CreateHttpHeader(Key="X-RapidAPI-Host", Value="distance-calculator8.p.rapidapi.com")
ch_2 = CreateHttpHeader(Key="X-RapidAPI-Key", Value="d182559d7fmshe14f3302f24be3ep103472jsn27e1f3f1839f")
cqp_7 = CreateQueryParam(Key="startLatitude", Value=pdecon_7.XComponent)
cqp_8 = CreateQueryParam(Key="startLongitude", Value=pdecon_7.YComponent)
cqp_9 = CreateQueryParam(Key="endLatitude", Value=pdecon_8.XComponent)
cqp_10 = CreateQueryParam(Key="endLongitude", Value=pdecon_8.YComponent)
merge_3 = Merge(Data1=graft(cqp_7), Data2=graft(cqp_8), Data3=graft(cqp_9), Data4=graft(cqp_10))
merge_4 = Merge(Data1=ch_2, Data2=ch)
get_4 = GETRequest(URL="https://distance-calculator8.p.rapidapi.com/calc", Params=merge_3, Headers=merge_4)  # -> Status, Content, Response
pjs_4 = ParseJSONString(Text=get_4.Content)
gjok_18 = GetJSONObjectKey(JObject=pjs_4, Key="body")
gjok_19 = GetJSONObjectKey(JObject=gjok_18, Key="distance")
gjok_20 = GetJSONObjectKey(JObject=gjok_19, Key="kilometers")
rjv_6 = ReadJSONValue(JValue=gjok_20)  # -> AsString, flatten(AsNumber), AsBool
ma = MassAddition(Input=rjv_6.AsNumber)  # -> Result, PartialResults
distance = DirectDataOutput(Data=ma.Result)

gjok_21 = GetJSONObjectKey(JObject=item_4, Key="distance")
rjv_7 = ReadJSONValue(JValue=gjok_21)  # -> AsString, AsNumber, AsBool
division_3 = Division(A=rjv_7.AsNumber, B="1000")
panel_6 = Panel(rjv_7.AsNumber)

addition = Addition(A=division_2, B=division_3)

round_2 = Round(Number=addition)  # -> Nearest, Floor, Ceiling
